# Grasshopper definition packing.gh (Grasshopper 1.0.7)
# plug-ins: Human

python = GhPythonScript(file_name="rooms.json")  # -> out, path
# ---------- python: Python ----------
local_folder = "\\".join(ghenv.Component.OnPingDocument().FilePath.split("\\")[:-1]) + "\\"

path = local_folder + file_name
# ---------- end python ----------
file = ReadFile(File=python.path, PerLineParse=False)

# ---- group: read program from file
python_2 = GhPythonScript(file=file)  # -> out, names, areas, adjacencies
# ---------- python_2: Python ----------
import json




rooms = json.loads(file)
print rooms

print len(rooms)
print rooms[0]["name"]

names = [room["name"] for room in rooms]
areas = [room["area"] for room in rooms]

adjacencies = {}

for room in rooms:
    adjacencies[room["name"]] = room["adjacency"]

adjacencies = json.dumps(adjacencies)
# ---------- end python_2 ----------

# ----
python_3 = GhPythonScript(a=python_2.areas)  # -> out, r
# ---------- python_3: Python ----------
import math

r = math.sqrt(a / math.pi)
# ---------- end python_3 ----------
ma = MassAddition(Input=python_2.areas)  # -> Result, PartialResults
python_4 = GhPythonScript(a=ma.Result)  # -> out, x
# ---------- python_4: Python ----------
import math

x = math.sqrt(a)
# ---------- end python_4 ----------
division = Division(A=python_4.x, B="2")
neg = Negative(Value=division)
dom = ConstructDomain(DomainStart=division, DomainEnd=neg)
lng = ListLength(List=python_2.areas)
galapagos = Galapagos(fitness=num_2, gene=[genes_2, genes])

button = Button()

genes = GenePool(Decimals=2, Maximum=100, Minimum=0, Value=[62.73, 62.94, 0, 0.01, 31.16, 0, 100, 11.39, 0, 47.87])
remap = RemapNumbers(Value=genes, Source="0 to 100", Target=dom)  # -> Mapped, Clipped
resetgenepool = PythonScript(GenePool=genes, num_params=lng, Reset=button)  # inputs GenePool: list, Reset: Boolean
# ---------- resetgenepool: Python ----------
import random

from System import Decimal

# Check input values exist
if num_params > 0:
    
    # Get genepool input parameter (must be first input in this case)
    gp = ghenv.Component.Params.Input[0].Sources[0]
    
    # Update and reset genepool
    if Reset:
        
        # Set gene pool count and values
        gp.Count = num_params
        
        for i in range(gp.Count):
            gp[i] = int(random.random() * 100.0)
            
        # Update gene pool
        gp.ExpireSolution(True)
# ---------- end resetgenepool ----------

genes_2 = GenePool(Decimals=2, Maximum=100, Minimum=0, Value=[32.06, 0, 53.86, 100, 9.02, 100, 80, 100, 100, 79.85])
remap_2 = RemapNumbers(Value=genes_2, Source="0 to 100", Target=dom)  # -> Mapped, Clipped
resetgenepool_2 = PythonScript(GenePool=genes_2, num_params=lng, Reset=button)  # inputs GenePool: list, Reset: Boolean; same code as resetgenepool

pt = ConstructPoint(XCoordinate=remap_2.Mapped, YCoordinate=remap.Mapped, ZCoordinate=0)
python_5 = GhPythonScript(names=python_2.names, points=pt, radii=python_3.r, adj=python_2.adjacencies, max_iter=Slider(800, range=0..1000))  # -> out, centers, lines, edge_adj, room_adj; inputs names: list, points: list of Point3d, radii: list, max_iter: Int32
# ---------- python_5: Python ----------
import Rhino.Geometry as rh
import json


class Room:
    
    def __init__(self, cp, r, name):
        self.cp = cp
        self.r = r
        self.name = name
        self.neighbors = []
    
    def addNeighbor(self, neighbor):
        self.neighbors.append(neighbor)
    
    def cluster(self, other):
        
        d = self.cp.DistanceTo(other.cp)
        
        if d > self.r + other.r:
            
            vec = rh.Vector3d(self.cp) - rh.Vector3d(other.cp)
            vec.Unitize()
            vec *= (d - self.r + other.r) * 0.5 * 0.01
            
            other.cp.Transform(rh.Transform.Translation(vec))
            
            vec.Reverse()
            self.cp.Transform(rh.Transform.Translation(vec))
            
    
    def collide(self, other):
        d = self.cp.DistanceTo(other.cp)
        
        if d < self.r + other.r:
            
            vec = rh.Vector3d(self.cp) - rh.Vector3d(other.cp)
            vec.Unitize()
            vec *= (self.r + other.r - d) * 0.5 * 1.0
            
            self.cp.Transform(rh.Transform.Translation(vec))
            
            vec.Reverse()
            other.cp.Transform(rh.Transform.Translation(vec))
            


adjacencies = json.loads(adj)

rooms = []
rooms_d = {}

for i in range(len(points)):
    room = Room(points[i], radii[i], names[i])
    rooms.append(room)
    rooms_d[names[i]] = room


for key_1 in adjacencies.keys():
    for key_2 in adjacencies[key_1]:
        rooms_d[key_1].addNeighbor(rooms_d[key_2])

for room in rooms:
    print room.name, [r.name for r in room.neighbors]


for i in range(max_iter):

    for room_1 in rooms:
        
        for room_2 in room_1.neighbors:
            room_1.cluster(room_2)
        
        for room_2 in rooms:
            if room_1 != room_2:
                room_1.collide(room_2)

centers = [room.cp for room in rooms]


lines = []
edge_adj = []
room_adj = []

for room_1 in rooms:
    
    room_adj.append(0)
    
    for room_2 in room_1.neighbors:
        
        line = rh.Line(room_1.cp, room_2.cp)
        
        p = room_1.r + room_2.r
        
        if p / line.Length < 0.95:
            room_adj[-1] += 1
            edge_adj.append(1)
        else:
            edge_adj.append(0)
        
        lines.append(line)
# ---------- end python_5 ----------

# ---- group: move geometry to origin
cir = Circle(Plane=python_5.centers, Radius=python_3.r)
bbox = BoundingBox(Content=cir, Plane=PlaneXY(0, 0, 0), UnionBox=True)  # -> Box, Box_2
area = Area(Geometry=bbox.Box)  # -> Area, Centroid
pt_2 = ConstructPoint(XCoordinate=0, YCoordinate=0, ZCoordinate=0)
vec2pt = Vector2Pt(PointA=area.Centroid, PointB=pt_2, Unitize=False)  # -> Vector, Length
move = Move(Geometry=python_5.lines, Motion=vec2pt.Vector)  # -> Geometry, Transform
move_2 = Move(Geometry=python_5.centers, Motion=vec2pt.Vector)  # -> Geometry, Transform

# ---- group: calc adjacency penalty
ma_2 = MassAddition(Input=python_5.edge_adj)  # -> Result, PartialResults
addition = Addition(A=ma_2.Result, B="1")
panel = Panel(ma_2.Result)

# ---- group: viz room names
tag = TextTag(Location=move_2.Geometry, Text=python_2.names, Colour=ColourSwatch(SwatchColor=RGB(0, 0, 0)))

# ---- group: viz edges
gradient = Gradient(LowerLimit=0, UpperLimit=1, Parameter=python_5.edge_adj, stops=[0: RGB(0, 0, 0), 1: RGB(255, 0, 47)])
remap_3 = RemapNumbers(Value=python_5.edge_adj, Source=Domain(0, 1), Target="2 to 5")  # -> Mapped, Clipped
geo = Geometry(move.Geometry)
previewlw = CustomPreviewLineweights(Geometry=geo, Shader=gradient, Thickness=remap_3.Mapped, Absolute=False)

# ----
cir_2 = Circle(Plane=move_2.Geometry, Radius=python_3.r)

# ---- group: viz circles
gradient_2 = Gradient(LowerLimit=0, UpperLimit=1, Parameter=python_5.room_adj, stops=[0: RGB(0, 0, 0), 1: RGB(255, 0, 47)])
remap_4 = RemapNumbers(Value=python_5.room_adj, Source=Domain(0, 1), Target="2 to 5")  # -> Mapped, Clipped
previewlw_2 = CustomPreviewLineweights(Geometry=cir_2, Shader=gradient_2, Thickness=remap_4.Mapped, Absolute=False)

# ----
vec2pt_2 = Vector2Pt(PointA=pt, PointB=move_2.Geometry, Unitize=False)  # -> Vector, Length
vdis = VectorDisplay(Anchor=pt, Vector=vec2pt_2.Vector)

# ---- group: calc plan area
bbox_2 = BoundingBox(Content=cir_2, Plane=PlaneXY(0, 0, 0), UnionBox=True)  # -> Box, Box_2
wires = BrepWireframe(Brep=bbox_2.Box, Density=-1)
area_2 = Area(Geometry=bbox_2.Box)  # -> Area, Centroid
panel_2 = Panel(area_2.Area)

# ----
multiplication = Multiplication(A=addition, B=area_2.Area)
area_3 = Panel(multiplication)

# ---- group: Objective
num = Number(multiplication)

# ----
num_2 = Number(num)
